# Dynamo graph Wall-Generate Cold-formed Steel Structure.dyn "Wall-Generate Cold formed Steel Structure" (Dynamo 2.2.1.5175)

# group: input
select_model_elements = DSModelElementsSelection()  # 4 picked in the model; graph input
levels_of_bottom_of_the_wall = Levels("FLOOR")  # graph input
column = FamilyTypes("CC column:CC 17")  # graph input
STRIPE = FamilyTypes("L Stripe:L1")  # graph input
column_height = LengthFromString(Value=3.048)  # graph input
offset_of_stripes = LengthFromString(Value=0.01524)
space_between_column = LengthFromString(Value=0.4064)  # graph input
minimum_space_between_column = LengthFromString(Value=0.127)  # graph input
space_between_column_at_corner = LengthFromString(Value=0.0127)  # graph input
beam = FamilyTypes("U BEAM:11")  # graph input
height_of_top_beam_2 = LengthFromString(Value=2.7432)  # graph input
height_of_middle_beam = LengthFromString(Value=1.524)  # graph input

# group: FILTER OUT LINES
code_block = CodeBlock { "Lines"; }
getCategory = Element.GetCategory(element=select_model_elements)
name = Category.Name(category=getCategory)
eq = code_block == name
filterByBoolMask = List.FilterByBoolMask(list=select_model_elements, mask=eq)

# group: GET CURVE
curves = Element.Curves(element=filterByBoolMask.in)
byJoinedCurves = PolyCurve.ByJoinedCurves(curves=curves)
curves_2 = PolyCurve.Curves(polyCurve=byJoinedCurves)
flatten = List.Flatten(list=curves_2)

# group: GET DIRECTION OF CURVE
startPoint = Curve.StartPoint(curve=flatten)
endPoint = Curve.EndPoint(curve=flatten)
byTwoPoints = Vector.ByTwoPoints(start=startPoint, end=endPoint)
XAxis = Vector.XAxis()
isParallel = Vector.IsParallel(vector=byTwoPoints, other=XAxis)
filterByBoolMask_2 = List.FilterByBoolMask(list=flatten, mask=isParallel)

# group: GET PARAMETER FROM COLUMN
code_block_2 = CodeBlock { "B"; }
getParameterValueByName = Element.GetParameterValueByName(element=column, parameterName=code_block_2)
code_block_3 = CodeBlock { "t1"; }
getParameterValueByName_2 = Element.GetParameterValueByName(element=STRIPE, parameterName=code_block_3)

code_block_4 = CodeBlock(COLUMNHEIGHT=column_height) { COLUMNHEIGHT; }
length = Curve.Length(curve=filterByBoolMask_2.out)
x_or_y = BoolSelector(true)
length_2 = Curve.Length(curve=filterByBoolMask_2.in)

# group: SHORTEN X CURVE
code_block_5 = CodeBlock { "D"; }
getParameterValueByName_3 = Element.GetParameterValueByName(element=column, parameterName=code_block_5)
x_curve = Python(IN[0]=filterByBoolMask_2.in)
# ---------- x_curve.python (13 lines) ----------
# Load the Python Standard and DesignScript Libraries
import sys
import clr
clr.AddReference('ProtoGeometry')
from Autodesk.DesignScript.Geometry import *

# The inputs to this node will be stored as a list in the IN variables.
dataEnteringNode = IN

# Place your code below this line

# Assign your output to the OUT variable.
OUT = IN[0]
# ----------------------------------------
upgrade = Python(IN[0]=x_curve)
# ---------- upgrade.python (15 lines) ----------
# Load the Python Standard and DesignScript Libraries
import sys
import clr
clr.AddReference('ProtoGeometry')
from Autodesk.DesignScript.Geometry import *

# The inputs to this node will be stored as a list in the IN variables.
dataEnteringNode = IN

# Place your code below this line
a=[]
for n in IN[0]:
	a.append([n])
# Assign your output to the OUT variable.
OUT = a
# ----------------------------------------
code_block_6 = CodeBlock(D=getParameterValueByName_3, y=space_between_column_at_corner) { 5/2*D+y; }
pointAtSegmentLength = Curve.PointAtSegmentLength(curve=x_curve, segmentLength=code_block_6)
curve_length = Python(IN[0]=length_2)  # same code as x_curve
sub = curve_length - code_block_6
pointAtSegmentLength_2 = Curve.PointAtSegmentLength(curve=x_curve, segmentLength=sub)
ZIP = Python(IN[0]=pointAtSegmentLength, IN[1]=pointAtSegmentLength_2)
# ---------- ZIP.python (16 lines) ----------
# Enable Python support and load DesignScript library
import clr
clr.AddReference('ProtoGeometry')
from Autodesk.DesignScript.Geometry import *

# The inputs to this node will be stored as a list in the IN variables.
dataEnteringNode = IN

# Place your code below this line
a=[]
for i in range(len(IN[0])):
	a.append([])
	a[i].append(IN[0][i])
	a[i].append(IN[1][i])
# Assign your output to the OUT variable.
OUT = a
# ----------------------------------------
splitByPoints = Curve.SplitByPoints(curve=upgrade, points=ZIP)
python_script = Python(IN[0]=splitByPoints)
# ---------- python_script.python (15 lines) ----------
# Load the Python Standard and DesignScript Libraries
import sys
import clr
clr.AddReference('ProtoGeometry')
from Autodesk.DesignScript.Geometry import *

# The inputs to this node will be stored as a list in the IN variables.
dataEnteringNode = IN

# Place your code below this line
a=[]
for n in IN[0]:
	a.append(n[0][1])

OUT = a
# ----------------------------------------

# group: SHORTEN Y CURVE
y_curve = Python(IN[0]=filterByBoolMask_2.out)  # same code as x_curve
upgrade_2 = Python(IN[0]=y_curve)  # same code as upgrade
code_block_7 = CodeBlock { "B"; }
getParameterValueByName_4 = Element.GetParameterValueByName(element=column, parameterName=code_block_7)
code_block_8 = CodeBlock(y=getParameterValueByName_4, D=getParameterValueByName_3) { y/2+D; }
pointAtSegmentLength_3 = Curve.PointAtSegmentLength(curve=y_curve, segmentLength=code_block_8)
curve_length_2 = Python(IN[0]=length)  # same code as x_curve
sub_2 = curve_length_2 - code_block_8
pointAtSegmentLength_4 = Curve.PointAtSegmentLength(curve=y_curve, segmentLength=sub_2)
ZIP_2 = Python(IN[0]=pointAtSegmentLength_3, IN[1]=pointAtSegmentLength_4)  # same code as ZIP
splitByPoints_2 = Curve.SplitByPoints(curve=upgrade_2, points=ZIP_2)
python_script_2 = Python(IN[0]=splitByPoints_2)  # same code as python_script

# group: Y ADD START AND END POINT TO LIST
endPoint_2 = Curve.EndPoint(curve=python_script_2)
startPoint_2 = Curve.StartPoint(curve=python_script_2)
flatten_2 = List.Flatten(list=startPoint_2)
flatten_3 = List.Flatten(list=endPoint_2)
getParameterValueByName_5 = Element.GetParameterValueByName(element=column, parameterName=code_block_9.out0)
code_block_9 = CodeBlock(D=getParameterValueByName_5) { "D"; D/2; }

# group: GET RIGHT SIDE OF Y
byTwoPoints_2 = Vector.ByTwoPoints(start=startPoint_2, end=endPoint_2)
normalized = Vector.Normalized(vector=byTwoPoints_2)
string_from_object = FromObject(obj=normalized)
YAxis = Vector.YAxis()
string_from_object_2 = FromObject(obj=YAxis)
eq_2 = string_from_object == string_from_object_2
end_point_inx_out_x = List.FilterByBoolMask(list=endPoint_2, mask=eq_2)
start_point_inx_out_x = List.FilterByBoolMask(list=startPoint_2, mask=eq_2)

# group: MOVE POINT TO TOP AND BOTTOM
X = Point.X(point=end_point_inx_out_x.out)
Y = Point.Y(point=end_point_inx_out_x.out)
elevation = Level.Elevation(level=levels_of_bottom_of_the_wall)
bottom_point = Point.ByCoordinates(x=X, y=Y, z=elevation)
code_block_10 = CodeBlock(x=elevation, y=code_block_4, z=offset_of_stripes) { x+y-z; }
top_point = Point.ByCoordinates(x=X, y=Y, z=code_block_10)

# group: MOVE POINTS ALONG -X
XAxis_2 = Vector.XAxis()
code_block_11 = CodeBlock(B=getParameterValueByName, t=getParameterValueByName_2) { (B/2+t); }
translate = Geometry.Translate(geometry=bottom_point, direction=XAxis_2, distance=code_block_11)
XAxis_3 = Vector.XAxis()
code_block_12 = CodeBlock(B=getParameterValueByName, t=getParameterValueByName_2) { (B/2+t); }
translate_2 = Geometry.Translate(geometry=top_point, direction=XAxis_3, distance=code_block_12)

# group: MOVE POINT TO TOP AND BOTTOM
X_2 = Point.X(point=start_point_inx_out_x.out)
Y_2 = Point.Y(point=start_point_inx_out_x.out)
elevation_2 = Level.Elevation(level=levels_of_bottom_of_the_wall)
code_block_13 = CodeBlock(x=elevation_2, y=code_block_4, z=offset_of_stripes) { x+y-z; }
top_point_2 = Point.ByCoordinates(x=X_2, y=Y_2, z=code_block_13)
bottom_point_2 = Point.ByCoordinates(x=X_2, y=Y_2, z=elevation_2)

# group: MOVE POINTS ALONG -X
XAxis_4 = Vector.XAxis()
code_block_14 = CodeBlock(B=getParameterValueByName, t=getParameterValueByName_2) { (B/2+t); }
translate_3 = Geometry.Translate(geometry=top_point_2, direction=XAxis_4, distance=code_block_14)
XAxis_5 = Vector.XAxis()
code_block_15 = CodeBlock(B=getParameterValueByName, t=getParameterValueByName_2) { (B/2+t); }
translate_4 = Geometry.Translate(geometry=bottom_point_2, direction=XAxis_5, distance=code_block_15)

# group: MOVE POINT TO TOP AND BOTTOM
X_3 = Point.X(point=end_point_inx_out_x.in)
Y_3 = Point.Y(point=end_point_inx_out_x.in)
elevation_3 = Level.Elevation(level=levels_of_bottom_of_the_wall)
bottom_point_3 = Point.ByCoordinates(x=X_3, y=Y_3, z=elevation_3)
code_block_16 = CodeBlock(x=elevation_3, y=code_block_4, z=offset_of_stripes) { x+y-z; }
top_point_3 = Point.ByCoordinates(x=X_3, y=Y_3, z=code_block_16)

# group: MOVE POINTS ALONG X
XAxis_6 = Vector.XAxis()
code_block_17 = CodeBlock(B=getParameterValueByName, t=getParameterValueByName_2) { -(B/2+t); }
translate_5 = Geometry.Translate(geometry=bottom_point_3, direction=XAxis_6, distance=code_block_17)
XAxis_7 = Vector.XAxis()
code_block_18 = CodeBlock(B=getParameterValueByName, t=getParameterValueByName_2) { -(B/2+t); }
translate_6 = Geometry.Translate(geometry=top_point_3, direction=XAxis_7, distance=code_block_18)

# group: MOVE POINT TO TOP AND BOTTOM
X_4 = Point.X(point=start_point_inx_out_x.in)
Y_4 = Point.Y(point=start_point_inx_out_x.in)
elevation_4 = Level.Elevation(level=levels_of_bottom_of_the_wall)
code_block_19 = CodeBlock(x=elevation_4, y=code_block_4, z=offset_of_stripes) { x+y-z; }
top_point_4 = Point.ByCoordinates(x=X_4, y=Y_4, z=code_block_19)
bottom_point_4 = Point.ByCoordinates(x=X_4, y=Y_4, z=elevation_4)

# group: MOVE POINTS ALONG X
XAxis_8 = Vector.XAxis()
code_block_20 = CodeBlock(B=getParameterValueByName, t=getParameterValueByName_2) { -(B/2+t); }
translate_7 = Geometry.Translate(geometry=top_point_4, direction=XAxis_8, distance=code_block_20)
XAxis_9 = Vector.XAxis()
code_block_21 = CodeBlock(B=getParameterValueByName, t=getParameterValueByName_2) { -(B/2+t); }
translate_8 = Geometry.Translate(geometry=bottom_point_4, direction=XAxis_9, distance=code_block_21)

# group: CREATE STRIPE
byStartPointEndPoint = Line.ByStartPointEndPoint(startPoint=translate, endPoint=translate_3)
byStartPointEndPoint_2 = Line.ByStartPointEndPoint(startPoint=translate_4, endPoint=translate_2)
byStartPointEndPoint_3 = Line.ByStartPointEndPoint(startPoint=translate_5, endPoint=translate_7)
byStartPointEndPoint_4 = Line.ByStartPointEndPoint(startPoint=translate_8, endPoint=translate_6)
join = List.Join(list0=byStartPointEndPoint, list1=byStartPointEndPoint_2, list2=byStartPointEndPoint_3, list3=byStartPointEndPoint_4)
upgrade_3 = Python(IN[0]=join)  # same code as upgrade
byJoinedCurves_2 = PolyCurve.ByJoinedCurves(curves=upgrade_3)
curves_3 = PolyCurve.Curves(polyCurve=byJoinedCurves_2)
flatten_4 = List.Flatten(list=curves_3)
columnByCurve = StructuralFraming.ColumnByCurve(curve=flatten_4, level=levels_of_bottom_of_the_wall, structuralColumnType=STRIPE)

# group: POINT ON CURVE
code_block_22 = CodeBlock { 2; }
div = length / code_block_22
pointAtSegmentLength_5 = Curve.PointAtSegmentLength(curve=filterByBoolMask_2.out, segmentLength=div)
pointsAtSegmentLengthFromPoint = Curve.PointsAtSegmentLengthFromPoint(curve=python_script_2, point=pointAtSegmentLength_5, segmentLength=space_between_column)
div_2 = length_2 / code_block_22
pointAtSegmentLength_6 = Curve.PointAtSegmentLength(curve=filterByBoolMask_2.in, segmentLength=div_2)
pointsAtSegmentLengthFromPoint_2 = Curve.PointsAtSegmentLengthFromPoint(curve=python_script, point=pointAtSegmentLength_6, segmentLength=space_between_column)

# group: Y GET RID OF TOO CLOSE POINT
y_points = Python(IN[0]=pointsAtSegmentLengthFromPoint)  # same code as x_curve
ZIP_3 = Python(IN[0]=flatten_2, IN[1]=flatten_3)
# ---------- ZIP_3.python (15 lines) ----------
# Enable Python support and load DesignScript library
import clr
clr.AddReference('ProtoGeometry')
from Autodesk.DesignScript.Geometry import *

# The inputs to this node will be stored as a list in the IN variables.
dataEnteringNode = IN
A=[]
# Place your code below this line
for i in range(len(IN[0])):
	A.append([])
	A[i].append(IN[0][i])
	A[i].append(IN[1][i])
# Assign your output to the OUT variable.
OUT = A
# ----------------------------------------
upgrade_and_duplicate_list = Python(IN[0]=ZIP_3, IN[1]=y_points)
# ---------- upgrade_and_duplicate_list.python (17 lines) ----------
# Load the Python Standard and DesignScript Libraries
import sys
import clr
clr.AddReference('ProtoGeometry')
from Autodesk.DesignScript.Geometry import *

# The inputs to this node will be stored as a list in the IN variables.
dataEnteringNode = IN

# Place your code below this line
a=[]
for i in range(len(IN[1])):
	a.append([])
	for j in range(len(IN[1][i])):
		a[i].append(IN[0][i])
# Assign your output to the OUT variable.
OUT = a
# ----------------------------------------
byTwoPoints_3 = Vector.ByTwoPoints(start=upgrade_and_duplicate_list, end=y_points)
length_3 = Vector.Length(vector=byTwoPoints_3)
lt = length_3 < minimum_space_between_column
python_script_3 = Python(IN[0]=lt)
# ---------- python_script_3.python (24 lines) ----------
# Load the Python Standard and DesignScript Libraries
import sys
import clr
clr.AddReference('ProtoGeometry')
from Autodesk.DesignScript.Geometry import *

# The inputs to this node will be stored as a list in the IN variables.
dataEnteringNode = IN

# Place your code below this line
a=[]
for i in range(len(IN[0])):
	a.append ([])
	for j in range(len(IN[0][i])):
		for n in IN[0][i][j]:
			f=0
			if n==True:
				a[i].append(True)
				f=1
				break
		if f==0:
				a[i].append(False)
# Assign your output to the OUT variable.
OUT = a
# ----------------------------------------
filterByBoolMask_3 = List.FilterByBoolMask(list=y_points, mask=python_script_3)

# group (continued): Y ADD START AND END POINT TO LIST
python_script_4 = Python(IN[0]=flatten_2, IN[1]=flatten_3, IN[2]=filterByBoolMask_3.out)
# ---------- python_script_4.python (14 lines) ----------
# Enable Python support and load DesignScript library
import clr
clr.AddReference('ProtoGeometry')
from Autodesk.DesignScript.Geometry import *

# The inputs to this node will be stored as a list in the IN variables.
dataEnteringNode = IN

# Place your code below this line
for i in range(len(IN[2])):
	IN[2][i].append(IN[0][i])
	IN[2][i].append(IN[1][i])
# Assign your output to the OUT variable.
OUT = IN[2]
# ----------------------------------------
translate_9 = Geometry.Translate(geometry=python_script_4, yTranslation=code_block_9.out1)

# group: SORT LIST BY Y
Y_5 = Point.Y(point=python_script_4)
code_block_23 = CodeBlock { true; }
sortListByAnother = archilab.Lists.Lists.SortListByAnother(list=python_script_4, sortBy=Y_5, reversed=code_block_23)

# group: CREATE COLUMN
byPointAndLevel = FamilyInstance.ByPointAndLevel(familyType=column, point=sortListByAnother.list, level=levels_of_bottom_of_the_wall)
code_block_24 = CodeBlock { "Top Offset"; "Top Level"; "Moves With Grids"; false; }
setParameterByName = Element.SetParameterByName(element=byPointAndLevel, parameterName=code_block_24.out0, value=code_block_4)
setParameterByName_2 = Element.SetParameterByName(element=setParameterByName, parameterName=code_block_24.out1, value=levels_of_bottom_of_the_wall)
setParameterByName_3 = Element.SetParameterByName(element=setParameterByName_2, parameterName=code_block_24.out2, value=code_block_24.out3)
firstItem = List.FirstItem(list=setParameterByName_3@@L2)
code_block_25 = CodeBlock { 180; }
setRotation = FamilyInstance.SetRotation(familyInstance=firstItem, degree=code_block_25)

# group: ADD MORE POINT TO X
x_curve_2 = Python(IN[0]=filterByBoolMask_2.in)  # same code as x_curve
code_block_26 = CodeBlock(D=getParameterValueByName_3, y=space_between_column_at_corner) { D+y; 2*D+y; 5*D/2+y; }
pointAtSegmentLength_7 = Curve.PointAtSegmentLength(curve=x_curve_2, segmentLength=code_block_26.out2)
sub_3 = curve_length - code_block_26.out2
pointAtSegmentLength_8 = Curve.PointAtSegmentLength(curve=x_curve_2, segmentLength=sub_3)
pointAtSegmentLength_9 = Curve.PointAtSegmentLength(curve=x_curve_2, segmentLength=code_block_26.out0)
sub_4 = curve_length - code_block_26.out0
pointAtSegmentLength_10 = Curve.PointAtSegmentLength(curve=x_curve_2, segmentLength=sub_4)
pointAtSegmentLength_11 = Curve.PointAtSegmentLength(curve=x_curve_2, segmentLength=code_block_26.out1)
sub_5 = curve_length - code_block_26.out1
pointAtSegmentLength_12 = Curve.PointAtSegmentLength(curve=x_curve_2, segmentLength=sub_5)
ZIP_4 = Python(IN[0]=pointAtSegmentLength_9, IN[1]=pointAtSegmentLength_10, IN[2]=pointAtSegmentLength_11, IN[3]=pointAtSegmentLength_12)
# ---------- ZIP_4.python (18 lines) ----------
# Enable Python support and load DesignScript library
import clr
clr.AddReference('ProtoGeometry')
from Autodesk.DesignScript.Geometry import *

# The inputs to this node will be stored as a list in the IN variables.
dataEnteringNode = IN

# Place your code below this line
a=[]
for i in range(len(IN[0])):
	a.append([])
	a[i].append(IN[0][i])
	a[i].append(IN[1][i])
	a[i].append(IN[2][i])
	a[i].append(IN[3][i])
# Assign your output to the OUT variable.
OUT = a
# ----------------------------------------

# group: X GET RID OF TOO CLOSE POINT
x_points = Python(IN[0]=pointsAtSegmentLengthFromPoint_2)  # same code as x_curve
ZIP_5 = Python(IN[0]=pointAtSegmentLength_7, IN[1]=pointAtSegmentLength_8)  # same code as ZIP_3
upgrade_and_duplicate_list_2 = Python(IN[0]=ZIP_5, IN[1]=x_points)  # same code as upgrade_and_duplicate_list
byTwoPoints_4 = Vector.ByTwoPoints(start=upgrade_and_duplicate_list_2, end=x_points)
length_4 = Vector.Length(vector=byTwoPoints_4)
lt_2 = length_4 < minimum_space_between_column
python_script_5 = Python(IN[0]=lt_2)  # same code as python_script_3
filterByBoolMask_4 = List.FilterByBoolMask(list=x_points, mask=python_script_5)

# group: X ADD START AND END POINT TO LIST
endPoint_3 = Curve.EndPoint(curve=filterByBoolMask_2.in)
startPoint_3 = Curve.StartPoint(curve=filterByBoolMask_2.in)
flatten_5 = List.Flatten(list=startPoint_3)
flatten_6 = List.Flatten(list=endPoint_3)
ZIP_6 = Python(IN[0]=flatten_5, IN[1]=flatten_6, IN[2]=filterByBoolMask_4.out)  # same code as python_script_4

# group: GET RIGHT SIDE OF X
byTwoPoints_5 = Vector.ByTwoPoints(start=startPoint_3, end=endPoint_3)
normalized_2 = Vector.Normalized(vector=byTwoPoints_5)
string_from_object_3 = FromObject(obj=normalized_2)
XAxis_10 = Vector.XAxis()
string_from_object_4 = FromObject(obj=XAxis_10)
eq_3 = string_from_object_3 == string_from_object_4
end_point_iny_out_y = List.FilterByBoolMask(list=endPoint_3, mask=eq_3)
start_point_iny_out_y = List.FilterByBoolMask(list=startPoint_3, mask=eq_3)

# group: MOVE POINT TO TOP AND BOTTOM
X_5 = Point.X(point=end_point_iny_out_y.out)
Y_6 = Point.Y(point=end_point_iny_out_y.out)
elevation_5 = Level.Elevation(level=levels_of_bottom_of_the_wall)
bottom_point_5 = Point.ByCoordinates(x=X_5, y=Y_6, z=elevation_5)
code_block_27 = CodeBlock(x=elevation_5, y=code_block_4, z=offset_of_stripes) { x+y-z; }
top_point_5 = Point.ByCoordinates(x=X_5, y=Y_6, z=code_block_27)

# group: MOVE POINTS ALONG -Y
YAxis_2 = Vector.YAxis()
code_block_28 = CodeBlock(B=getParameterValueByName, t=getParameterValueByName_2) { -(B/2+t); }
translate_10 = Geometry.Translate(geometry=bottom_point_5, direction=YAxis_2, distance=code_block_28)
YAxis_3 = Vector.YAxis()
code_block_29 = CodeBlock(B=getParameterValueByName, t=getParameterValueByName_2) { -(B/2+t); }
translate_11 = Geometry.Translate(geometry=top_point_5, direction=YAxis_3, distance=code_block_29)

# group: MOVE POINT TO TOP AND BOTTOM
X_6 = Point.X(point=start_point_iny_out_y.out)
Y_7 = Point.Y(point=start_point_iny_out_y.out)
elevation_6 = Level.Elevation(level=levels_of_bottom_of_the_wall)
code_block_30 = CodeBlock(x=elevation_6, y=code_block_4, z=offset_of_stripes) { x+y-z; }
top_point_6 = Point.ByCoordinates(x=X_6, y=Y_7, z=code_block_30)
bottom_point_6 = Point.ByCoordinates(x=X_6, y=Y_7, z=elevation_6)

# group: MOVE POINTS ALONG -Y
YAxis_4 = Vector.YAxis()
code_block_31 = CodeBlock(B=getParameterValueByName, t=getParameterValueByName_2) { -(B/2+t); }
translate_12 = Geometry.Translate(geometry=top_point_6, direction=YAxis_4, distance=code_block_31)
YAxis_5 = Vector.YAxis()
code_block_32 = CodeBlock(B=getParameterValueByName, t=getParameterValueByName_2) { -(B/2+t); }
translate_13 = Geometry.Translate(geometry=bottom_point_6, direction=YAxis_5, distance=code_block_32)

# group: MOVE POINT TO TOP AND BOTTOM
X_7 = Point.X(point=end_point_iny_out_y.in)
Y_8 = Point.Y(point=end_point_iny_out_y.in)
elevation_7 = Level.Elevation(level=levels_of_bottom_of_the_wall)
bottom_point_7 = Point.ByCoordinates(x=X_7, y=Y_8, z=elevation_7)
code_block_33 = CodeBlock(x=elevation_7, y=code_block_4, z=offset_of_stripes) { x+y-z; }
top_point_7 = Point.ByCoordinates(x=X_7, y=Y_8, z=code_block_33)

# group: MOVE POINTS ALONG Y
YAxis_6 = Vector.YAxis()
code_block_34 = CodeBlock(B=getParameterValueByName, t=getParameterValueByName_2) { (B/2+t); }
translate_14 = Geometry.Translate(geometry=bottom_point_7, direction=YAxis_6, distance=code_block_34)
YAxis_7 = Vector.YAxis()
code_block_35 = CodeBlock(B=getParameterValueByName, t=getParameterValueByName_2) { (B/2+t); }
translate_15 = Geometry.Translate(geometry=top_point_7, direction=YAxis_7, distance=code_block_35)

# group: MOVE POINT TO TOP AND BOTTOM
X_8 = Point.X(point=start_point_iny_out_y.in)
Y_9 = Point.Y(point=start_point_iny_out_y.in)
elevation_8 = Level.Elevation(level=levels_of_bottom_of_the_wall)
code_block_36 = CodeBlock(x=elevation_8, y=code_block_4, z=offset_of_stripes) { x+y-z; }
top_point_8 = Point.ByCoordinates(x=X_8, y=Y_9, z=code_block_36)
bottom_point_8 = Point.ByCoordinates(x=X_8, y=Y_9, z=elevation_8)

# group: MOVE POINTS ALONG Y
YAxis_8 = Vector.YAxis()
code_block_37 = CodeBlock(B=getParameterValueByName, t=getParameterValueByName_2) { (B/2+t); }
translate_16 = Geometry.Translate(geometry=top_point_8, direction=YAxis_8, distance=code_block_37)
YAxis_9 = Vector.YAxis()
code_block_38 = CodeBlock(B=getParameterValueByName, t=getParameterValueByName_2) { (B/2+t); }
translate_17 = Geometry.Translate(geometry=bottom_point_8, direction=YAxis_9, distance=code_block_38)

# group: CREATE STRIPE
byStartPointEndPoint_5 = Line.ByStartPointEndPoint(startPoint=translate_10, endPoint=translate_12)
byStartPointEndPoint_6 = Line.ByStartPointEndPoint(startPoint=translate_13, endPoint=translate_11)
byStartPointEndPoint_7 = Line.ByStartPointEndPoint(startPoint=translate_14, endPoint=translate_16)
byStartPointEndPoint_8 = Line.ByStartPointEndPoint(startPoint=translate_17, endPoint=translate_15)
join_2 = List.Join(list0=byStartPointEndPoint_5, list1=byStartPointEndPoint_6, list2=byStartPointEndPoint_7, list3=byStartPointEndPoint_8)
upgrade_4 = Python(IN[0]=join_2)  # same code as upgrade
byJoinedCurves_3 = PolyCurve.ByJoinedCurves(curves=upgrade_4)
curves_4 = PolyCurve.Curves(polyCurve=byJoinedCurves_3)
flatten_7 = List.Flatten(list=curves_4)
columnByCurve_2 = StructuralFraming.ColumnByCurve(curve=flatten_7, level=levels_of_bottom_of_the_wall, structuralColumnType=STRIPE)

# group (continued): ADD MORE POINT TO X
ZIP_7 = Python(IN[0]=ZIP_6, IN[1]=ZIP_4)
# ---------- ZIP_7.python (15 lines) ----------
# Enable Python support and load DesignScript library
import clr
clr.AddReference('ProtoGeometry')
from Autodesk.DesignScript.Geometry import *

# The inputs to this node will be stored as a list in the IN variables.
dataEnteringNode = IN

# Place your code below this line
for i in range(len(IN[0])):
	for n in IN[1][i]:
		IN[0][i].append(n)

# Assign your output to the OUT variable.
OUT = IN[0]
# ----------------------------------------

# group: SORT LIST BY X
X_9 = Point.X(point=ZIP_7)
sortListByAnother_2 = archilab.Lists.Lists.SortListByAnother(list=ZIP_7, sortBy=X_9)

# group: CREATE COLUMN
byPointAndLevel_2 = FamilyInstance.ByPointAndLevel(familyType=column, point=sortListByAnother_2.list, level=levels_of_bottom_of_the_wall)
code_block_39 = CodeBlock { "Top Offset"; "Top Level"; "Moves With Grids"; false; }
setParameterByName_4 = Element.SetParameterByName(element=byPointAndLevel_2, parameterName=code_block_39.out0, value=code_block_4)
setParameterByName_5 = Element.SetParameterByName(element=setParameterByName_4, parameterName=code_block_39.out1, value=levels_of_bottom_of_the_wall)
setParameterByName_6 = Element.SetParameterByName(element=setParameterByName_5, parameterName=code_block_39.out2, value=code_block_39.out3)

COLUMN = Python(IN[0]=x_or_y, IN[1]=setParameterByName_6, IN[2]=setParameterByName_3)
# ---------- COLUMN.python (14 lines) ----------
# Enable Python support and load DesignScript library
import clr
clr.AddReference('ProtoGeometry')
from Autodesk.DesignScript.Geometry import *

# The inputs to this node will be stored as a list in the IN variables.
dataEnteringNode = IN

# Place your code below this line
if IN[0]:
	OUT=IN[1]
else:
	OUT=IN[2]
# Assign your output to the OUT variable.
# ----------------------------------------
start = Revit.Transaction.Transaction.Start(input=COLUMN)
POINT = Python(IN[0]=x_or_y, IN[1]=sortListByAnother_2.list, IN[2]=python_script_4)  # same code as COLUMN

# group: ROTATE COLUMN
code_block_40 = CodeBlock { 90; -90; }
setRotation_2 = FamilyInstance.SetRotation(familyInstance=start, degree=code_block_40.out0)
python_script_6 = Python(IN[0]=setRotation_2)
# ---------- python_script_6.python (21 lines) ----------
# Load the Python Standard and DesignScript Libraries
import sys
import clr
clr.AddReference('ProtoGeometry')
from Autodesk.DesignScript.Geometry import *

# The inputs to this node will be stored as a list in the IN variables.
dataEnteringNode = IN

# Place your code below this line
a=[]
for j in range(len(IN[0])):
	a.append ([])
	n=IN[0][j]
	for i in range(len(n)):
		if i ==1 or i ==(len(n)-3) or i ==(len(n)-1):
			a[j].append(True)
		else:
			a[j].append(False)		
# Assign your output to the OUT variable.
OUT = a
# ----------------------------------------
filterByBoolMask_5 = List.FilterByBoolMask(list=setRotation_2, mask=python_script_6)
setRotation_3 = FamilyInstance.SetRotation(familyInstance=filterByBoolMask_5.in, degree=code_block_40.out1)
python_script_7 = Python(IN[0]=setRotation_2, IN[1]=setRotation_3, IN[2]=setRotation_2)
# ---------- python_script_7.python (27 lines) ----------
# Load the Python Standard and DesignScript Libraries
import sys
import clr
clr.AddReference('ProtoGeometry')
from Autodesk.DesignScript.Geometry import *

# The inputs to this node will be stored as a list in the IN variables.
dataEnteringNode = IN

# Place your code below this line
a=[]
for i in range(len(IN[0])):
	a.append([])
	n=IN[0][i]
	x=0
	y=0
	for m in n:
		if m==True:
			a[i].append(IN[1][i][x])
			x=x+1

		else:
			a[i].append(IN[2][i][y])
			y=y+1
            	
# Assign your output to the OUT variable.
OUT = a
# ----------------------------------------
X_10 = Point.X(point=POINT)
Y_10 = Point.Y(point=POINT)
location = FamilyInstance.Location(familyInstance=setRotation_2)
Z = Point.Z(point=location)
byCoordinates = Point.ByCoordinates(x=X_10, y=Y_10, z=Z)
filterByBoolMask_6 = List.FilterByBoolMask(list=byCoordinates, mask=python_script_6)
code_block_41 = CodeBlock { "D"; "B"; }
getParameterValueByName_6 = Element.GetParameterValueByName(element=column, parameterName=code_block_41.out0)
code_block_42 = CodeBlock(d=getParameterValueByName_6) { -d; }
translate_18 = Geometry.Translate(geometry=filterByBoolMask_6.in, xTranslation=code_block_42)
reassemble = Python(IN[0]=python_script_6, IN[1]=translate_18, IN[2]=filterByBoolMask_6.out)  # same code as python_script_7
getParameterValueByName_7 = Element.GetParameterValueByName(element=column, parameterName=code_block_41.out1)
python_script_8 = Python(IN[0]=reassemble, IN[1]=getParameterValueByName_6, IN[2]=getParameterValueByName_7)
# ---------- python_script_8.python (22 lines) ----------
# Load the Python Standard and DesignScript Libraries
import sys
import clr
clr.AddReference('ProtoGeometry')
from Autodesk.DesignScript.Geometry import *

# The inputs to this node will be stored as a list in the IN variables.
dataEnteringNode = IN

# Place your code below this line
a=[]
B=IN[2]
D=IN[1]
for i in range(len(IN[0])):
	a.append ([])
	for j in range(len(IN[0][i])):
		if j == (len(IN[0][i])-1) or j == (len(IN[0][i])-2) or j == (len(IN[0][i])-3) :
			a[i].append(B/2)
		elif j == 0 or j == 1 or 2 :
			a[i].append(D-B/2)		
# Assign your output to the OUT variable.
OUT = a
# ----------------------------------------
translate_19 = Geometry.Translate(geometry=reassemble, xTranslation=python_script_8)
setLocation = Element.SetLocation(element=python_script_7, geometry=translate_19)

end = Revit.Transaction.Transaction.End(input=setLocation)
firstItem_2 = List.FirstItem(list=sortListByAnother_2.list@@L2)
lastItem = List.LastItem(list=sortListByAnother_2.list@@L2)
byStartPointEndPoint_9 = Line.ByStartPointEndPoint(startPoint=firstItem_2, endPoint=lastItem)
firstItem_3 = List.FirstItem(list=sortListByAnother.list@@L2)
lastItem_2 = List.LastItem(list=sortListByAnother.list@@L2)
byStartPointEndPoint_10 = Line.ByStartPointEndPoint(startPoint=firstItem_3, endPoint=lastItem_2)
join_3 = List.Join(list0=byStartPointEndPoint_9, list1=byStartPointEndPoint_10)

# group: TOP BEAM
XY = Plane.XY()
elevation_9 = Level.Elevation(level=levels_of_bottom_of_the_wall)
code_block_43 = CodeBlock(x=elevation_9, y=code_block_4) { x+y; }
offset = Plane.Offset(plane=XY, dist=code_block_43)
pullOntoPlane = Curve.PullOntoPlane(curve=join_3, plane=offset)

start_2 = Revit.Transaction.Transaction.Start(input=pullOntoPlane)

# group (continued): TOP BEAM
beamByCurve = StructuralFraming.BeamByCurve(curve=start_2, level=levels_of_bottom_of_the_wall, structuralFramingType=beam)

end_2 = Revit.Transaction.Transaction.End(input=beamByCurve)

# group: BOTTOM BEAM
XY_2 = Plane.XY()
offset_2 = Plane.Offset(plane=XY_2, dist=elevation_9)
pullOntoPlane_2 = Curve.PullOntoPlane(curve=join_3, plane=offset_2)
code_block_44 = CodeBlock { "Cross-Section Rotation"; 180; }

start_3 = Revit.Transaction.Transaction.Start(input=pullOntoPlane_2)

# group (continued): BOTTOM BEAM
beamByCurve_2 = StructuralFraming.BeamByCurve(curve=start_3, level=levels_of_bottom_of_the_wall, structuralFramingType=beam)
setParameterByName_7 = Element.SetParameterByName(element=beamByCurve_2, parameterName=code_block_44.out0, value=code_block_44.out1)

end_3 = Revit.Transaction.Transaction.End(input=setParameterByName_7)

# group: REFORM CURVE X
byStartPointEndPoint_11 = Line.ByStartPointEndPoint(startPoint=pointAtSegmentLength_7, endPoint=pointAtSegmentLength_8)
python_script_9 = Python(IN[0]=byStartPointEndPoint_11)
# ---------- python_script_9.python (17 lines) ----------
# Load the Python Standard and DesignScript Libraries
import sys
import clr
clr.AddReference('ProtoGeometry')
from Autodesk.DesignScript.Geometry import *

# The inputs to this node will be stored as a list in the IN variables.
dataEnteringNode = IN


# Place your code below this line
a=[]
for n in IN[0]:
	a.append ([n])

# Assign your output to the OUT variable.
OUT = a
# ----------------------------------------
byJoinedCurves_4 = PolyCurve.ByJoinedCurves(curves=python_script_9)
curves_5 = PolyCurve.Curves(polyCurve=byJoinedCurves_4)
ZIP_8 = Python(IN[0]=pointAtSegmentLength_7, IN[1]=pointAtSegmentLength_8)
# ---------- ZIP_8.python (17 lines) ----------
# Enable Python support and load DesignScript library
import clr
clr.AddReference('ProtoGeometry')
from Autodesk.DesignScript.Geometry import *

# The inputs to this node will be stored as a list in the IN variables.
dataEnteringNode = IN

# Place your code below this line
a=[]
for i in range(len(IN[0])):
	a.append([])
	a[i].append(IN[0][i])
	a[i].append(IN[1][i])

# Assign your output to the OUT variable.
OUT = a
# ----------------------------------------
x_point_for_beam = Python(IN[0]=filterByBoolMask_4.out, IN[1]=ZIP_8)  # same code as ZIP_7

# group: SPLITED CURVE
splitByPoints_3 = Curve.SplitByPoints(curve=curves_5, points=x_point_for_beam)
splitByPoints_4 = Curve.SplitByPoints(curve=python_script_2, points=python_script_4)
join_4 = List.Join(list0=splitByPoints_3, list1=splitByPoints_4)
flatten_8 = List.Flatten(list=join_4)

# group: TOP BEAM 2
XY_3 = Plane.XY()
elevation_10 = Level.Elevation(level=levels_of_bottom_of_the_wall)
code_block_45 = CodeBlock(x=elevation_10, y=height_of_top_beam_2) { x+y; }
offset_3 = Plane.Offset(plane=XY_3, dist=code_block_45)
pullOntoPlane_3 = Curve.PullOntoPlane(curve=flatten_8, plane=offset_3)

start_4 = Revit.Transaction.Transaction.Start(input=pullOntoPlane_3)

# group (continued): TOP BEAM 2
beamByCurve_3 = StructuralFraming.BeamByCurve(curve=start_4, level=levels_of_bottom_of_the_wall, structuralFramingType=beam)

end_4 = Revit.Transaction.Transaction.End(input=beamByCurve_3)

# group: MIDDLE BEAM
XY_4 = Plane.XY()
elevation_11 = Level.Elevation(level=levels_of_bottom_of_the_wall)
code_block_46 = CodeBlock(x=elevation_11, y=height_of_middle_beam) { x+y; }
offset_4 = Plane.Offset(plane=XY_4, dist=code_block_46)
pullOntoPlane_4 = Curve.PullOntoPlane(curve=flatten_8, plane=offset_4)

start_5 = Revit.Transaction.Transaction.Start(input=pullOntoPlane_4)

# group (continued): MIDDLE BEAM
beamByCurve_4 = StructuralFraming.BeamByCurve(curve=start_5, level=levels_of_bottom_of_the_wall, structuralFramingType=beam)

end_5 = Revit.Transaction.Transaction.End(input=beamByCurve_4)
